# Grasshopper definition AT_APY-HW_3-Deniz_E_Arslan.gh (Grasshopper 1.0.7)
# plug-ins: Hops

python = GhPythonScript(x=Slider(10, range=0..10), y=Slider(10, range=0..10))  # -> out, a, b, c, d, e, f, g; inputs x: Int32, y: Int32
# ---------- python: Python ----------
import Rhino.Geometry as rg
import ghpythonlib.treehelpers as th #this library is needed to import nested lists to grasshopper trees
import math #this library is needed to create sine and cosine waves


#----------------------------------------------------------
#1.- create first series of points -
#start by initializing an empty list and fill it with points 
#by creating points with a for loop. The number of points should come 
#from a grasshopper slider
#Increment the X coordinate of the point at each iteration so to create
#a series of points along the X axis line
#store that point to the list
#output this list to grasshopper to verify the result should look like gh component (1.)

pointList1 = []

for i in range(x):
    pointList1.append(rg.Point3d(i,0,0))

a = pointList1

#----------------------------------------------------------
#2. - create second series of points -
#create a second list of points  by copying the code above, but this time
#assign the Y coordinate of each point to a value that comes from an 
#external input which can be a slider in grasshopper
#output that list as well, the result should look like component (2.) 

pointList2 = []

for i in range(x):
    p2=rg.Point3d(i,y,0)
    pointList2.append(p2)

b = pointList2

#----------------------------------------------------------
#3. - create lines from two series of points - 
#initialize another empty list to store some lines
#make another for loop that iterates through each point in any of the list BY INDEX
#within this loop, make a line that draws from points in both lists with the same index
#and append that line to the line list. output the result
#hint: you only need one for loop for this

lineList = []

for j in range(len(a)):
    lineList.append(rg.Line(a[j],b[j]))
###c=[rg.Line(ap,bp) for ap,bp in zip(a,b)]
c = lineList


#----------------------------------------------------------
#4.- divide curve -
#initialize another empty list to store some curves
#interate through every line in the line list with a for loop 
#inside the scope of this for loop, create an empty list to store the division points
#inside the for loop, convert each line to a nurbs curve, like shown in class
#divide the new curve into 10 points by applying DivideByCount() method (see rhinocommo) and store the result
#this returns a list of parameters in the line which correspond to each parameter
#you need to iterate through the list of params with another for loop and get the point per each param 
#using Line.PointAt(), and there the points in the list of divison points

allDivPts = [] 

for line in lineList:
    linePts =[] 
    nC = rg.Line.ToNurbsCurve(line)
    params = rg.Curve.DivideByCount(nC, 10, 1)
    for p in params:
        divPt= rg.Curve.PointAt(nC,p)
        linePts.append(divPt)
    allDivPts.append(linePts) #append the list of points PER LINE to another list

d = th.list_to_tree(allDivPts) #this is how you output nested lists to gh trees


#----------------------------------------------------------
#5.- apply sine function to points
#here we will use the sin() the math library to move the points in Z, 
#it makes sense to follow the logic of group 5. of gh components
#first, create a nested for loop to iterate the nested list by index (I´ve done that for you)
#second, transfer the pt to a vector3d
#third, get the vector length (it´s one of it´s properties)
#forth, create a variable that will be the magnitude of displacement, by passign the vector length to the math.sin() function
#fifth, create another 3d vector, which is is the Z vector times the previous variable
#sixth, get a new point by substracting the point to the vector (literally, a point - a vector results in another point)
#finally, append that point to a list, and then append that list to the nested list

allMovedPts = [] #list of all moved points

for list in allDivPts:
    movedPts= [] #list of moved points
    for pt in list:
        v1= rg.Vector3d(pt)
        len1= v1.Length #calling it on the instance
        magDisplacement= math.sin(len1)
        vZ= rg.Vector3d.ZAxis*magDisplacement
        newPt= pt-vZ
        movedPts.append(newPt)
    allMovedPts.append(movedPts)

d = th.list_to_tree(allMovedPts) #output list of list to gh



#----------------------------------------------------------
#6.- make a curve from a list of points
#again, initialize a en empty list which will contain curves
#interate through the list of list of points with a for loop
#create a curve with rg.Curve.CreateInterpolatedCurve() as in 6. (see rhinocommon)
#append that curve to the list of curves and output it to gh

#make a curve from list of points
curveList = []

for pt in allMovedPts:
    curveList.append(rg.Curve.CreateInterpolatedCurve(pt,3))
    
e= curveList


#----------------------------------------------------------
# 7.- create a loft surface from curves
#use rg.Brep.CreateFromLoft() (see rc) to create a surface from loft
#store it in a variable and output it to gh
"""
for curve in curveList:
    rg.Brep.CreateFromLoft(curve,0)  ASK!!!!
"""
surface_brep = rg.Brep.CreateFromLoft(curveList,rg.Point3d.Unset,rg.Point3d.Unset,rg.LoftType.Tight,0) 

if surface_brep == None or surface_brep.Length != 1:
    raise Exception("Unexpected result, conversion failed or more than one result")
assert surface_brep != None and surface_brep.Length ==1, "Unexpected result, conversion failed or more than one result" #i expect it to be true
f = surface_brep[0]


#----------------------------------------------------------
#8.- create a mesh from Brep
#The last step is to create a mesh from a Brep using rg.Mesh
#There are different ways to approach this, but the suggestion is to use allMovedPts
#and find a way to create mesh faces from that list and merge them into a larger mesh



meshes = rg.Mesh.CreateFromBrep(f, rg.MeshingParameters.Minimal)#QUADS FACE
if meshes == None or meshes.Length == 0:
    raise Exception("Mesh could not be created from Brep")

mesh1 = meshes[0]
mesh1.Faces.ConvertQuadsToTriangles()#TRIANGLE FACE
g= mesh1

"""

#THE END
"""
# ---------- end python ----------
concat = Concatenate(FragmentA="http://127.0.0.1:5000/", FragmentB="gridMesh")
concat_2 = Concatenate(FragmentA="http://127.0.0.1:5000/", FragmentB="shortestPath")
mesh = Mesh(python.g)
hops = Hops(
    _Path=concat,
    CacheResultsInMemory=False,
    CacheSolveResults=False,
    RemoteDefinitionLocation="http://127.0.0.1:5000/gridMesh",
    RemoteSolveVersion=(0, 1, 0),
    ShowInput_Enabled=False,
    ShowInput_Path=True,
    SynchronousSolve=True)
panel = Panel(concat)
panel_2 = Panel(concat_2)
explodemesh = GhPythonScript(m=mesh)  # -> out, a; inputs m: Mesh
# ---------- explodemesh: Python ----------
import Rhino.Geometry as rg

ghenv.Component.Message = "explode mesh"

exploded = []

for i in range(m.Faces.Count):
    m_copy = m.Duplicate()
    face = m_copy.Faces.ExtractFaces([i])
    exploded.append(face)
    
a = exploded
# ---------- end explodemesh ----------
hops_2 = Hops(
    _Path=concat_2,
    InputMesh=mesh,
    FaceIndex1=Slider(10, range=0..10),
    FaceIndex2=Slider(56, range=0..100),
    CacheResultsInMemory=True,
    CacheSolveResults=True,
    RemoteDefinitionLocation="http://127.0.0.1:5000/shortestPath",
    RemoteSolveVersion=(0, 1, 0),
    ShowInput_Enabled=False,
    ShowInput_Path=True,
    SynchronousSolve=True)
item = ListItem(List=explodemesh.a, Index=hops_2, Wrap=True)
preview = CustomPreview(Geometry=item, Material=ColourSwatch(SwatchColor=RGB(0, 154, 181)))
