# Grasshopper definition MPDA22-session03_hops_DEA_inclass.gh (Grasshopper 1.0.7)
# plug-ins: Kangaroo2 Components, Hops

subd = SubD(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)
subd_2 = SubD(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)
meshsubd = MeshFromSubD(SubD=subd, Density=Slider(1, range=0..2))
triremesh = TriRemesh(Geometry=meshsubd, Length=Slider(1, range=1..2), Iterations=25)  # -> Triangulation, Dual, Creases
concat = Concatenate(FragmentA="http://127.0.0.1:5000", FragmentB="/meshFromPoints")
meshsubd_2 = MeshFromSubD(SubD=subd_2, Density=Slider(1, range=0..2))
triremesh_2 = TriRemesh(Geometry=meshsubd_2, Length=Slider(1, range=1..2), Iterations=25)  # -> Triangulation, Dual, Creases
pop2d = Populate2D(Region={Plane=PlaneXY(0, 0, 0), Size=Domain2(u=0..20, v=0..10)}, Count=Slider(5, range=0..10), Seed=1)
data = Data(triremesh.Triangulation)
data_2 = Data(meshsubd)
panel = Panel(concat)
hops = Hops(
    _Path=concat,
    Points=pop2d,
    CacheResultsInMemory=False,
    CacheSolveResults=False,
    RemoteDefinitionLocation="http://127.0.0.1:5000/meshFromPoints",
    RemoteSolveVersion=(0, 1, 0),
    ShowInput_Enabled=False,
    ShowInput_Path=True,
    SynchronousSolve=True)
concat_2 = Concatenate(FragmentA="http://127.0.0.1:5000", FragmentB="/gridMesh")
clean = CombineClean(Meshes=data_2)
data_3 = Data(triremesh_2.Triangulation)
data_4 = Data(meshsubd_2)
points = PointList(Size=Slider(0.7, range=0.5..1))
clean_2 = CombineClean(Meshes=data_4)
explodemesh = GhPythonScript(m=clean)  # -> out, a; inputs m: Mesh
# ---------- explodemesh: Python ----------
import Rhino.Geometry as rg

ghenv.Component.Message = "explode mesh"

exploded = []

for i in range(m.Faces.Count):
    m_copy = m.Duplicate()
    face = m_copy.Faces.ExtractFaces([i])
    exploded.append(face)
    
a = exploded
# ---------- end explodemesh ----------
hops_2 = Hops(
    _Path=concat_2,
    CacheResultsInMemory=False,
    CacheSolveResults=False,
    RemoteDefinitionLocation="http://127.0.0.1:5000/gridMesh",
    RemoteSolveVersion=(0, 1, 0),
    ShowInput_Enabled=False,
    ShowInput_Path=True,
    SynchronousSolve=True)
explodemesh_2 = GhPythonScript(m=clean_2)  # -> out, a; inputs m: Mesh; same code as explodemesh
concat_3 = Concatenate(FragmentA="http://127.0.0.1:5000", FragmentB="/meshgraph")
panel_2 = Panel(concat_3)
concat_4 = Concatenate(FragmentA="http://127.0.0.1:5000", FragmentB="/shortestpath")
panel_3 = Panel(concat_4)
hops_3 = Hops(
    _Path=concat_4,
    CacheResultsInMemory=True,
    CacheSolveResults=True,
    RemoteDefinitionLocation="http://127.0.0.1:5000/shortestpath",
    RemoteSolveVersion=(0, 1, 0),
    ShowInput_Enabled=False,
    ShowInput_Path=True,
    SynchronousSolve=True)
